test file "Test_LKAS"

suite "New Test Suite 1"

  case "New Test Case 1" [equivalence]
    simulation 1:
      model LKAS_TestHarness, stop time 90
      input "1.mat", mapped to LKASve_d_IMAP_LKA_Main_Switch, LKASve_d_IMAP_LKA_Mode, LKASve_d_IMAP_EPS_LKA_State, LKASve_g_IMAP_EPS_SW_Trq, LKASve_g_IMAP_ESC_LatAcc, LKASve_g_IMAP_ESC_YawRate, LKASve_g_IMAP_ESC_VehSpd, LKASve_g_IMAP_ESC_LonAcc, LKASve_g_IMAP_ESC_Brake_Press, LKASve_g_IMAP_SW_Angle, LKASve_g_IMAP_SW_Angle_Speed, LKASve_d_IMAP_BCM_Double_Light, LKASve_d_IMAP_TCU_ActualGear, LKASve_g_IMAP_O_L0_C3, LKASve_g_IMAP_O_L0_C2, LKASve_g_IMAP_O_L0_C1, LKASve_g_IMAP_O_L0_C0, LKASve_d_IMAP_O_L0_Q, LKASve_d_IMAP_O_L0_Type, LKASve_g_IMAP_O_L0_VR, LKASve_g_IMAP_O_L0_TLC, LKASve_g_IMAP_O_R0_C3, LKASve_g_IMAP_O_R0_C2, LKASve_g_IMAP_O_R0_C1, LKASve_g_IMAP_O_R0_C0, LKASve_d_IMAP_O_R0_Q, LKASve_d_IMAP_O_R0_Type, LKASve_g_IMAP_O_R0_VR, LKASve_g_IMAP_O_R0_TLC, LKASve_g_IMAP_L0_C0, LKASve_g_IMAP_L0_C1, LKASve_g_IMAP_L0_C2, LKASve_g_IMAP_L0_C3, LKASve_g_IMAP_L0_VR, LKASve_d_IMAP_L0_Q, LKASve_d_IMAP_L0_Type, LKASve_g_IMAP_L0_TLC, LKASve_g_IMAP_R0_C0, LKASve_g_IMAP_R0_C1, LKASve_g_IMAP_R0_C2, LKASve_g_IMAP_R0_C3, LKASve_g_IMAP_R0_VR, LKASve_d_IMAP_R0_Q, LKASve_d_IMAP_R0_Type, LKASve_g_IMAP_R0_TLC, ADAS_541_PSA1__LDW_Flag, ADAS_541_PSA1__Vehicle_Lane_Display, ADAS_3F2_PSA1__Column_angle_setpoint3F2, ADAS_3F2_PSA1__Permit_to_know_if_LKA_or_LPA3F2 (active)
    simulation 2:
      model LKAS_SIL, mode Software-in-the-Loop (SIL), stop time 90
      pre-load callback:
        load('D:\LKAS\TestCase\1.mat')
        try
            delete('LKAS_SIL_sbs.mexw64')
            rmdir LKAS_SIL_autosar_rtw s
            rmdir slprj s
        catch
        end

        try
            rmdir slprj s
        catch
        end
    equivalence criteria
      LKASve_d_IMAP_LKA_Main_Switch:1
      LKASve_y_Vehicle_Lane_Display:1
      LKASve_y_LDW_Status_Display:1
      LKASve_y_EPS_LKA_Control:1
      LKASve_y_LKA_Status_Display:1
      LKASve_y_LDW_Flag:1
      LKASve_y_Hands_Off_Warning:1
      LKASve_y_LKA_Action_Indication:1
      LKASve_y_HMI_Popup_Status:1
      LKASve_y_EPS_State_Control:1
      LKASve_g_LKA_SWA_Control:1
      LKASve_g_EPS_Factor_Control:1
      LKASve_d_IMAP_EPS_LKA_State:1
      ADAS_541_PSA1__LDW_Flag:1
      ADAS_541_PSA1__Vehicle_Lane_Display:1
      ADAS_3F2_PSA1__Column_angle_setpoint3F2:1
      ADAS_3F2_PSA1__Permit_to_know_if_LKA_or_LPA3F2:1